# Dynamo graph 神经网络预测.dyn (Dynamo 2.0.0.5801)

file_path = Filename("..\..\..\data\optimized_graph.pb")
file_path_2 = Filename("..\..\..\data\output_labels.txt")
file_path_3 = Filename("..\..\..\data\flower.png")
predict = DeepLearning.Example.Predict(ModelFile=file_path, LabelFile=file_path_2, inputFile=file_path_3)
watch = Watch(predict)
file_from_path = FileObject(path=file_path_3)
readFromFile = Image.ReadFromFile(file=file_from_path)
watch_image = WatchImageCore(image=readFromFile)
file_from_path_2 = FileObject(path=file_path_2)
readText = FileSystem.ReadText(file=file_from_path_2)
watch_2 = Watch(readText)
